% Simulink data dictionary ctrlSys.sldd

Ts_local = 1.0e-5
f = 50
u_b = 0.5864
L_init = 0.2
L_ub = 0.6
L_lb = 0.01
u_ub = 1.12
u_lb = -1.08
Ts_ctrl = 0.02
Ts_meas = 0.001
v_ub = 0.1579
v_lb = -0.3612
Rn_seed = [22344 23213 5734]
Rn_SNR = 40
dist_seed = [25584 50645 69937]
Ts_dist = 0.1
dist_power = 2.0e-7
R_rms = 0
Ts_sup = 5